# Dynamo graph law21_1.dyn (Dynamo 2.3.1.11775)
# packages: Test package 0.0.1

# group: Input: Project Elements Wall Elements
mainStrucElements = Custom[mainStrucElements]()  # package Test package; 主要構造部Elements
categories = Categories("OST_ProjectInformation")
all_elements_of_category = ElementsOfCategory(Category=categories)
categories_2 = Categories("OST_Levels")
all_elements_of_category_2 = ElementsOfCategory(Category=categories_2)
code_block = CodeBlock { "高さ"; }
code_block_2 = CodeBlock { "MarketCategory"; }

# group: 21条1項判定
law21_1 = Custom[law21_1](element=mainStrucElements)  # package Test package; 基準法21条1項の判定

# group: 例外処理
対象建築物判定_未 = Python(IN[0]=all_elements_of_category)  # graph output
# ---------- 対象建築物判定_未.python (14 lines) ----------
# Python 標準ライブラリおよび DesignScript ライブラリをロード
import sys
import clr
clr.AddReference('ProtoGeometry')
from Autodesk.DesignScript.Geometry import *

# このノードへの入力は、リスト形式で IN 変数に格納されます。
dataEnteringNode = IN[0]

"""
判定なし
"""
# 出力を OUT 変数に割り当てます。
OUT = True
# ----------------------------------------

# group: 条件処理
getParameterValueByName = Element.GetParameterValueByName(element=all_elements_of_category_2, parameterName=code_block)
地上4階建て以上の判定 = Python(IN[0]=getParameterValueByName)
# ---------- 地上4階建て以上の判定.python (20 lines) ----------
# Python 標準ライブラリおよび DesignScript ライブラリをロード
import sys
import clr
clr.AddReference('ProtoGeometry')
from Autodesk.DesignScript.Geometry import *

# このノードへの入力は、リスト形式で IN 変数に格納されます。
elevations = IN[0]

cnt = 0
# この行の下にコードを配置します
for e in  elevations:
	if e >= 0:
		cnt += 1
	
# 出力を OUT 変数に割り当てます。
if cnt >= 4:
	OUT = True
else:
	OUT = False
# ----------------------------------------
建築物高さが16m以上かどうかの判定 = Python(IN[0]=getParameterValueByName)
# ---------- 建築物高さが16m以上かどうかの判定.python (17 lines) ----------
# Python 標準ライブラリおよび DesignScript ライブラリをロード
import sys
import clr
clr.AddReference('ProtoGeometry')
from Autodesk.DesignScript.Geometry import *

# このノードへの入力は、リスト形式で IN 変数に格納されます。
elevations = IN[0]

OUT = False
# この行の下にコードを配置します
for e in elevations:
	if e >= 160000:
		OUT = True
		break
	
# 出力を OUT 変数に割り当てます。
# ----------------------------------------
getParameterValueByName_2 = Element.GetParameterValueByName(element=all_elements_of_category, parameterName=code_block_2)
func_別表第一_い = Python(IN[0]=getParameterValueByName_2)
# ---------- func_別表第一_い.python (13 lines) ----------
# Python 標準ライブラリおよび DesignScript ライブラリをロード
import sys
import clr
clr.AddReference('ProtoGeometry')
from Autodesk.DesignScript.Geometry import *

# このノードへの入力は、リスト形式で IN 変数に格納されます。
dataEnteringNode = IN

# この行の下にコードを配置します

# 出力を OUT 変数に割り当てます。
OUT = 5
# ----------------------------------------
特殊建築物で高さが13m以上かどうかの判定 = Python(IN[0]=getParameterValueByName, IN[1]=func_別表第一_い)
# ---------- 特殊建築物で高さが13m以上かどうかの判定.python (19 lines) ----------
# Python 標準ライブラリおよび DesignScript ライブラリをロード
import sys
import clr
clr.AddReference('ProtoGeometry')
from Autodesk.DesignScript.Geometry import *

# このノードへの入力は、リスト形式で IN 変数に格納されます。
elevations = IN[0]
market_category = IN[1]

OUT = False

# この行の下にコードを配置します
for e in elevations:
	if e > 130000 and market_category in [5, 6]:
		OUT = True
		break
	
# 出力を OUT 変数に割り当てます。
# ----------------------------------------
条件判定 = Python(IN[0]=地上4階建て以上の判定, IN[1]=建築物高さが16m以上かどうかの判定, IN[2]=特殊建築物で高さが13m以上かどうかの判定)
# ---------- 条件判定.python (15 lines) ----------
# Python 標準ライブラリおよび DesignScript ライブラリをロード
import sys
import clr
clr.AddReference('ProtoGeometry')
from Autodesk.DesignScript.Geometry import *

# このノードへの入力は、リスト形式で IN 変数に格納されます。

OUT = False

# この行の下にコードを配置します
if any(IN):
	OUT = True
	
# 出力を OUT 変数に割り当てます。
# ----------------------------------------
watch = Watch(getParameterValueByName)

list_create = List.Create(item0=対象建築物判定_未, item1=条件判定)
logicalANDSwitch = Custom[logicalANDSwitch](value=law21_1.ok, bools=list_create)  # package Test package; boolフィールドの値がすべてtrueの場合値を通過させます

# group: 不適合Elements
color_palette = ColorPalette({R: 220, G: 20, B: 60, A: 255})
setColorOnElement = Custom[setColorOnElement](cutFillColor=color_palette, element=logicalANDSwitch)  # package Test package; 指定したElementに着色を行う

logicalANDSwitch_2 = Custom[logicalANDSwitch](value=law21_1.ng, bools=list_create)

# group: 適合Elements
color_palette_2 = ColorPalette({R: 0, G: 0, B: 255, A: 255})
setColorOnElement_2 = Custom[setColorOnElement](cutFillColor=color_palette_2, element=logicalANDSwitch_2)
