# Dynamo graph law21_2.dyn (Dynamo 2.6.1.8786)
# packages: Test package 0.0.1

# group: Input: Project Elements Wall Elements
boolean = BoolSelector(false)
mainStrucElements = Custom[mainStrucElements](slab=boolean, roof=boolean, stair=boolean)  # package Test package; 主要構造部Elements
code_block = CodeBlock { "FireRating"; 45; ">="; }
categories = Categories("OST_ProjectInformation")
all_elements_of_category = ElementsOfCategory(Category=categories)
code_block_2 = CodeBlock { "TotalArea"; 3000; ">"; }

# group: 条件処理
intParamFilter = Custom[intParamFilter](element=mainStrucElements, param=code_block.out0, values=code_block.out1, logic=code_block.out2)  # package Test package; 数値型プロパティに対するフィルター
intParamFilter_2 = Custom[intParamFilter](element=all_elements_of_category, param=code_block_2.out0, values=code_block_2.out1, logic=code_block_2.out2)
count = List.Count(list=intParamFilter_2.ok)
code_block_3 = CodeBlock { 0; }
gt = count > code_block_3
list_create = List.Create(item0=gt)
logicalANDSwitch = Custom[logicalANDSwitch](value=intParamFilter.ok, bools=list_create)  # package Test package; boolフィールドの値がすべてtrueの場合値を通過させます

# group: 21条2項判定
law107_1 = Custom[law107_1](elements=logicalANDSwitch)  # package Test package; 施行令第107条1のプログラム
low112_1 = Custom[low112_1]()  # package Test package; 施行令112条1
elements統合 = Python(IN[0]=law107_1.ok, IN[1]=low112_1.ok)
# ---------- elements統合.python (16 lines) ----------
# Python 標準ライブラリおよび DesignScript ライブラリをロード
import sys
import clr
clr.AddReference('ProtoGeometry')
from Autodesk.DesignScript.Geometry import *

# このノードへの入力は、リスト形式で IN 変数に格納されます。
elements = IN
rtn = set()
# この行の下にコードを配置します
for es in elements:
	for e in es:
		rtn.add(e)
	
# 出力を OUT 変数に割り当てます。
OUT = list(rtn)
# ----------------------------------------
elements統合_2 = Python(IN[0]=law107_1.ng, IN[1]=low112_1.ng)  # same code as elements統合

# group: 出力情報
file_path = Filename("..\..\tests\tests.xlsx")
code_block_4 = CodeBlock { "法第21条2"; }
code_block_5 = CodeBlock { "基準レベル"; "FireRating"; "IsExternal"; "LoadBearing"; }
list_create_2 = List.Create(item0=code_block_5.out0, item1=code_block_5.out1, item2=code_block_5.out2, item3=code_block_5.out3)
code_block_6 = CodeBlock { true; false; }

# group: 判定結果出力
toExcel = Custom[toExcel](elements=elements統合, path=file_path, sheetName=code_block_4, params=list_create_2, ok=code_block_6.out0)  # package Test package; Excelに結果を出力する（汎用性は低い）

# group: 不適合Elements
toExcel_2 = Custom[toExcel](elements=elements統合_2, path=file_path, sheetName=code_block_4, params=list_create_2, ok=code_block_6.out1)

# group: 例外Elements
watch = Watch(logicalANDSwitch)
