# Dynamo graph law22.dyn (Dynamo 2.6.1.8786)
# packages: Test package 0.0.1

# group: Input: Project Elements Wall Elements
categories = Categories("OST_Roofs")
all_elements_of_category = ElementsOfCategory(Category=categories)
categories_2 = Categories("OST_ProjectInformation")
all_elements_of_category_2 = ElementsOfCategory(Category=categories_2)

# group: 例外処理
code_block = CodeBlock { "MarketCategory"; "茶屋"; "東屋"; }
list_create = List.Create(item0=code_block.out1, item1=code_block.out2)
stringParamFilter = Custom[stringParamFilter](element=all_elements_of_category_2, param=code_block.out0, values=list_create)  # package Test package; stringのパラメータのElementsをFilterする
count = List.Count(list=stringParamFilter.ok)
code_block_2 = CodeBlock { 0; }
ne = count != code_block_2
code_block_3 = CodeBlock { "TotalArea"; 10; "<="; }
intParamFilter = Custom[intParamFilter](element=all_elements_of_category_2, param=code_block_3.out0, values=code_block_3.out1, logic=code_block_3.out2)  # package Test package; 数値型プロパティに対するフィルター
count_2 = List.Count(list=intParamFilter.ok)
ne_2 = count_2 != code_block_2
code_block_4 = CodeBlock { "MarketCategory"; "物置"; "納屋"; }
list_create_2 = List.Create(item0=code_block_4.out1, item1=code_block_4.out2)
stringParamFilter_2 = Custom[stringParamFilter](element=all_elements_of_category_2, param=code_block_4.out0, values=list_create_2)
count_3 = List.Count(list=stringParamFilter_2.ok)
ne_3 = count_3 != code_block_2
or_ = Or(bool0=ne_2, bool1=ne_3)
list_create_3 = List.Create(item0=ne, item1=or_)
not_ = Not(x=list_create_3)
logicalORSwitch = Custom[logicalORSwitch](value=all_elements_of_category, bools=not_)  # package Test package; boolsフィールドの値のうちどれか一つがtrueの場合値を通過させる

# group: 条件処理
対象地域内か = Python()  # unwired: IN[0]
# ---------- 対象地域内か.python (13 lines) ----------
# Python 標準ライブラリおよび DesignScript ライブラリをロード
import sys
import clr
clr.AddReference('ProtoGeometry')
from Autodesk.DesignScript.Geometry import *

# このノードへの入力は、リスト形式で IN 変数に格納されます。
dataEnteringNode = IN[0]

# この行の下にコードを配置します

# 出力を OUT 変数に割り当てます。
OUT = True
# ----------------------------------------
logicalANDSwitch = Custom[logicalANDSwitch](value=logicalORSwitch, bools=対象地域内か)  # package Test package; boolフィールドの値がすべてtrueの場合値を通過させます

# group: 例外Elements
watch = Watch(logicalANDSwitch)
watch_2 = Watch()  # unwired: arg0

# group: 22条判定
code_block_5 = CodeBlock { "FireRating"; 99; ">="; }
intParamFilter_2 = Custom[intParamFilter](element=logicalANDSwitch, param=code_block_5.out0, values=code_block_5.out1, logic=code_block_5.out2)

# group: 出力情報
file_path = Filename("..\..\tests\tests.xlsx")
code_block_6 = CodeBlock { "法第22条"; }
code_block_7 = CodeBlock { "基準レベル"; "FireRating"; "IsExternal"; "LoadBearing"; true; false; }
list_create_4 = List.Create(item0=code_block_7.out0, item1=code_block_7.out1, item2=code_block_7.out2, item3=code_block_7.out3)

# group: 適合Elements
toExcel = Custom[toExcel](elements=intParamFilter_2.ok, path=file_path, sheetName=code_block_6, params=list_create_4, ok=code_block_7.out4)  # package Test package; Excelに結果を出力する（汎用性は低い）

# group: 不適合Elements
toExcel_2 = Custom[toExcel](elements=intParamFilter_2.ng, path=file_path, sheetName=code_block_6, params=list_create_4, ok=code_block_7.out5)
