# Dynamo graph law25.dyn (Dynamo 2.6.1.8786)
# packages: Test package 0.0.1

# group: Input: Project Elements Wall Elements
categories = Categories("OST_ProjectInformation")
all_elements_of_category = ElementsOfCategory(Category=categories)
categories_2 = Categories("OST_Walls")
all_elements_of_category_2 = ElementsOfCategory(Category=categories_2)
categories_3 = Categories("OST_Roofs")
all_elements_of_category_3 = ElementsOfCategory(Category=categories_3)
code_block = CodeBlock { "TotalArea"; 1000; ">="; }
code_block_2 = CodeBlock { "IsExternal"; }
code_block_3 = CodeBlock { "FireRating"; 30; ">="; }

watch = Watch(all_elements_of_category)
watch_2 = Watch(all_elements_of_category_2)
watch_3 = Watch(all_elements_of_category_3)

# group: 条件処理
建築物が木造建築物等_未 = Python(IN[0]=all_elements_of_category)  # graph output
# ---------- 建築物が木造建築物等_未.python (14 lines) ----------
# Python 標準ライブラリおよび DesignScript ライブラリをロード
import sys
import clr
clr.AddReference('ProtoGeometry')
from Autodesk.DesignScript.Geometry import *

# このノードへの入力は、リスト形式で IN 変数に格納されます。
buildings = IN[0]

"""
判定なし
"""
# 出力を OUT 変数に割り当てます。
OUT = True
# ----------------------------------------
intSumParamJudge = Custom[intSumParamJudge](element=all_elements_of_category, param=code_block.out0, value=code_block.out1, logic=code_block.out2)  # package Test package; 全てのエレメントのパラメータの合計値を判定する
list_create = List.Create(item0=建築物が木造建築物等_未, item1=intSumParamJudge)
logicalANDSwitch = Custom[logicalANDSwitch](value=all_elements_of_category_2, bools=list_create)  # package Test package; boolフィールドの値がすべてtrueの場合値を通過させます
logicalANDSwitch_2 = Custom[logicalANDSwitch](value=all_elements_of_category_3, bools=list_create)

# group: 例外モデル
watch_4 = Watch(logicalANDSwitch)
watch_5 = Watch(logicalANDSwitch_2)

# group: 25条適合判定
延焼の恐れのある部分の範囲 = Python()  # unwired: IN[0]; starter script, not edited (OUT = 0)
特定範囲内にあるElementのFilter = Python(IN[0]=logicalANDSwitch, IN[1]=延焼の恐れのある部分の範囲)
# ---------- 特定範囲内にあるElementのFilter.python (13 lines) ----------
# Python 標準ライブラリおよび DesignScript ライブラリをロード
import sys
import clr
clr.AddReference('ProtoGeometry')
from Autodesk.DesignScript.Geometry import *

# このノードへの入力は、リスト形式で IN 変数に格納されます。
dataEnteringNode = IN[0]

# この行の下にコードを配置します

# 出力を OUT 変数に割り当てます。
OUT = dataEnteringNode
# ----------------------------------------
boolParamFilter = Custom[boolParamFilter](element=特定範囲内にあるElementのFilter, param=code_block_2)  # package Test package; bool型のPsetのElementsを分ける
intParamFilter = Custom[intParamFilter](element=boolParamFilter.ok, param=code_block_3.out0, values=code_block_3.out1, logic=code_block_3.out2)  # package Test package; 数値型プロパティに対するフィルター
特定範囲内にあるElementのFilter_2 = Python(IN[0]=logicalANDSwitch_2, IN[1]=延焼の恐れのある部分の範囲)  # same code as 特定範囲内にあるElementのFilter
law21_1 = Custom[law21_1](element=特定範囲内にあるElementのFilter_2)  # package Test package; 基準法21条1項の判定
join = List.Join(list0=intParamFilter.ok, list1=law21_1.ok)
join_2 = List.Join(list0=intParamFilter.ng, list1=law21_1.ng, list2=boolParamFilter.ng)

# group: 出力情報
file_path = Filename("..\..\tests\tests.xlsx")
code_block_4 = CodeBlock { "法第25条"; }
code_block_5 = CodeBlock { "基準レベル"; "FireRating"; "IsExternal"; "LoadBearing"; true; false; }
list_create_2 = List.Create(item0=code_block_5.out0, item1=code_block_5.out1, item2=code_block_5.out2, item3=code_block_5.out3)

# group: 判定結果出力
toExcel = Custom[toExcel](elements=join, path=file_path, sheetName=code_block_4, params=list_create_2, ok=code_block_5.out4)  # package Test package; Excelに結果を出力する（汎用性は低い）

# group: 不適合Elements
toExcel_2 = Custom[toExcel](elements=join_2, path=file_path, sheetName=code_block_4, params=list_create_2, ok=code_block_5.out5)
