# Dynamo graph law26.dyn (Dynamo 2.3.1.11775)
# packages: Test package 0.0.1

# group: Input: Project Elements Wall Elements
categories = Categories("OST_Floors")
all_elements_of_category = ElementsOfCategory(Category=categories)
categories_2 = Categories("OST_ProjectInformation")
all_elements_of_category_2 = ElementsOfCategory(Category=categories_2)
mainStrucElements = Custom[mainStrucElements]()  # package Test package; 主要構造部Elements
categories_3 = Categories("OST_Walls")
all_elements_of_category_3 = ElementsOfCategory(Category=categories_3)

# group: 例外処理
code_block = CodeBlock { "FireProtectionClass"; "耐火建築物"; "準耐火建築物"; }
list_create = List.Create(item0=code_block.out1, item1=code_block.out2)
stringParamJudge = Custom[stringParamJudge](element=all_elements_of_category_2, param=code_block.out0, values=list_create)  # 一つのElementに対する文字列パラメータの判定を行う
not_ = Not(x=stringParamJudge)
code_block_2 = CodeBlock { "MarketCategory"; "卸売場の上家"; "機械製作工場"; }
list_create_2 = List.Create(item0=code_block_2.out1, item1=code_block_2.out2)
stringParamJudge_2 = Custom[stringParamJudge](element=all_elements_of_category_2, param=code_block_2.out0, values=list_create_2)
code_block_3 = CodeBlock { "FireRating"; "2h"; }
list_create_3 = List.Create(item0=code_block_3.out1)
stringParamJudge_3 = Custom[stringParamJudge](element=mainStrucElements, param=code_block_3.out0, values=list_create_3)
防火構造として認定 = Python()  # unwired: IN[0]
# ---------- 防火構造として認定.python (13 lines) ----------
# Python 標準ライブラリおよび DesignScript ライブラリをロード
import sys
import clr
clr.AddReference('ProtoGeometry')
from Autodesk.DesignScript.Geometry import *

# このノードへの入力は、リスト形式で IN 変数に格納されます。
dataEnteringNode = IN

# この行の下にコードを配置します

# 出力を OUT 変数に割り当てます。
OUT = False
# ----------------------------------------
or_ = Or(bool0=stringParamJudge_3, bool1=防火構造として認定)
and_ = And(bool0=stringParamJudge_2, bool1=or_)
not_2 = Not(x=and_)
例外条件3 = Python()  # unwired: IN[0]; same code as 防火構造として認定
not_3 = Not(x=例外条件3)
list_create_4 = List.Create(item0=not_, item1=not_2, item2=not_3)
logicalANDSwitch = Custom[logicalANDSwitch](value=all_elements_of_category_2, bools=list_create_4)  # package Test package; boolフィールドの値がすべてtrueの場合値を通過させます

# group: 条件処理
code_block_4 = CodeBlock { "TotalArea"; 1000; ">="; }
intSumParamJudge = Custom[intSumParamJudge](element=logicalANDSwitch, param=code_block_4.out0, value=code_block_4.out1, logic=code_block_4.out2)  # package Test package; 全てのエレメントのパラメータの合計値を判定する
logicalANDSwitch_2 = Custom[logicalANDSwitch](value=all_elements_of_category, bools=intSumParamJudge)
logicalANDSwitch_3 = Custom[logicalANDSwitch](value=all_elements_of_category_3, bools=intSumParamJudge)
延焼の恐れのある部分の範囲 = Python()  # unwired: IN[0]; starter script, not edited (OUT = 0)
特定範囲内にあるElementのFilter = Python(IN[0]=logicalANDSwitch_3, IN[1]=延焼の恐れのある部分の範囲)
# ---------- 特定範囲内にあるElementのFilter.python (13 lines) ----------
# Python 標準ライブラリおよび DesignScript ライブラリをロード
import sys
import clr
clr.AddReference('ProtoGeometry')
from Autodesk.DesignScript.Geometry import *

# このノードへの入力は、リスト形式で IN 変数に格納されます。
dataEnteringNode = IN[0]

# この行の下にコードを配置します

# 出力を OUT 変数に割り当てます。
OUT = dataEnteringNode
# ----------------------------------------
特定範囲内にあるElementのFilter_2 = Python(IN[0]=logicalANDSwitch_2, IN[1]=延焼の恐れのある部分の範囲)  # same code as 特定範囲内にあるElementのFilter

# group: 例外Elements
watch = Watch(logicalANDSwitch_2)
watch_2 = Watch(logicalANDSwitch)

対象モデル = Watch(特定範囲内にあるElementのFilter)
対象モデル_2 = Watch(特定範囲内にあるElementのFilter_2)

# group: 22条判定
code_block_5 = CodeBlock { "FireRating"; "2h"; }
stringParamFilter = Custom[stringParamFilter](element=対象モデル, param=code_block_5.out0, values=code_block_5.out1)  # package Test package; stringのパラメータのElementsをFilterする
stringParamFilter_2 = Custom[stringParamFilter](element=対象モデル_2, param=code_block_5.out0, values=code_block_5.out1)

# group: 不適合Elements
color_palette = ColorPalette({R: 220, G: 20, B: 60, A: 255})
setColorOnElement = Custom[setColorOnElement](cutFillColor=color_palette, element=stringParamFilter.ng)  # package Test package; 指定したElementに着色を行う

# group: 適合Elements
color_palette_2 = ColorPalette({R: 0, G: 0, B: 255, A: 255})
setColorOnElement_2 = Custom[setColorOnElement](cutFillColor=color_palette_2, element=stringParamFilter.ok)

# group: 不適合Elements
color_palette_3 = ColorPalette({R: 220, G: 20, B: 60, A: 255})
setColorOnElement_3 = Custom[setColorOnElement](cutFillColor=color_palette_3, element=stringParamFilter_2.ng)

# group: 適合Elements
color_palette_4 = ColorPalette({R: 0, G: 0, B: 255, A: 255})
setColorOnElement_4 = Custom[setColorOnElement](cutFillColor=color_palette_4, element=stringParamFilter_2.ok)
